# Grasshopper definition example_4_generating_brick_pillar_from_boxes.ghx (Grasshopper 1.0.7)
# plug-ins: KUKA|prc - parametric robot control

# ----
# West_robot_pallet
pt = Point(Point(210.1999969, 1080.140015, -505.1600037))
pt_2 = Point(Point(220.0399933, 268.1600037, -500.519989))
pt_3 = Point(Point(1233.569946, 282.3399963, -496.480011))

# ----
# East_robot_pallet
pt_4 = Point(Point(3368.27002, -994.3200073, -491.4200134))
pt_5 = Point(Point(3378.870117, -176.3099976, -497.7799988))
pt_6 = Point(Point(2606.820068, -176.2299957, -493.1600037))

# ---- group: Target Center
pt_7 = Point(Point(734.5200195, 552.5800171, -503.6799927))

pt_8 = Point(Point(2918.580078, -537.3499756, -492.6499939))

# ----
frame = FrameKUKAPrc(
    FrameNumber=0,
    XValue=Slider(4363.63, range=-5000..5000),
    YValue=Slider(-1193.32, range=-4000..4000),
    ZValue=Slider(172.48, range=-4000..4000),
    AValue=0,
    BValue=0,
    CValue=0,
    toolaxis="Z")  # -> KUKAPrcFrame, XYZABCAsPlane
data = Data(frame.XYZABCAsPlane)
data_2 = Data([{Plane=Plane(origin=(879.5418497, 464.7382912, -502.7062724), x=(-0.2360544631, 0.971703558, -0.008395584219), y=(-0.9717188447, -0.2360973315, -0.004531767726)), X=Domain(1.19e-14, 180), Y=Domain(2.13e-14, 98), Z=Domain(-2.08e-16, 38)}, {Plane=Plane(origin=(808.989248, 733.4108544, -505.0613675), x=(-0.9595604378, 0.2813854874, -0.008122418059), y=(-0.2814302558, -0.9595686333, 0.005004905391)), X=Domain(1.64e-14, 180), Y=Domain(3.29e-15, 98), Z=Domain(2.62e-15, 38)}, {Plane=Plane(origin=(541.0318184, 806.6365472, -507.2916207), x=(-0.7235059771, -0.6903180618, 0.000273166082), y=(0.6902885801, -0.7234713042, 0.009536673077)), X=Domain(1.58e-15, 180), Y=Domain(-2.53e-14, 98), Z=Domain(7.82e-15, 38)}, {Plane=Plane(origin=(343.6269854, 611.1896779, -507.1667787), x=(0.2360544631, -0.971703558, 0.008395584219), y=(0.9717188447, 0.2360973315, 0.004531767726)), X=Domain(-1.97e-14, 180), Y=Domain(-4.23e-16, 98), Z=Domain(-1.53e-16, 38)}, {Plane=Plane(origin=(414.179587, 342.5171146, -504.8116836), x=(0.9595604378, -0.2813854874, 0.008122418059), y=(0.2814302558, 0.9595686333, -0.005004905391)), X=Domain(-8.55e-15, 180), Y=Domain(6.27e-16, 98), Z=Domain(1.18e-14, 38)}, {Plane=Plane(origin=(682.1370167, 269.2914219, -502.5814304), x=(0.7235059771, 0.6903180618, -0.000273166082), y=(-0.6902885801, 0.7234713042, -0.009536673077)), X=Domain(-1.77e-15, 180), Y=Domain(9.88e-15, 98), Z=Domain(5.75e-15, 38)}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])
# 1 / Select Your Robot
list = ValueList({"East_robot": 0, "West_robot": 1}, selected="West_robot")
# Save The File
save_krl_file = Button()
gripper_open_waiting_time_sec = Panel("0.5")
# Preview Path
number_slider = Slider(0, range=0..1)
# File Name
krl_file_name = Panel("PRC_0822_A01")
average_brick_dimensions_l_w_h_mm = Panel("""180.0
89.0
40.0""")
picking_retraction_distance_mm = Panel("500")
placing_retraction_distance_mm = Panel("400")
gripper_close_waiting_time_sec = Panel("0.5")
# 4 / Rest Position
pt_9 = Point(Point(2921.410743, -535.3386755, 1016.60198))
# 3 / Form (Boxs)
data_3 = Data(data_2)
# 2 / Target Position
pt_10 = Point(Point(3368.27002, -994.3200073, -491.4200134))
pt_11 = Point(Point(3378.870117, -176.3099976, -497.7799988))

# ---- group: Target Center
pt_12 = Point(Point(2918.580078, -537.3499756, -492.6499939))

# ----
pt_13 = Point(Point(2606.820068, -176.2299957, -493.1600037))

# ---- group: RAC-Coon Workcell
mesh = Mesh([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])

# ---- group: East_robot Original Position
# *Original Position
pln = Plane(PlaneXY(4363.629883, -1193.319946, 172.4799957))

# ---- group: West_robot Original Position
pln_2 = Plane(PlaneXY(-719.4899902, 964.4400024, 163.6100006))

# ----
panel = Panel("7*6 = 42")
Y = UnitY(Factor=Slider(4, range=0..10))

data_4 = Data(data_3)
debrep = DeconstructBrep(Brep=flatten(data_4))  # -> Faces, Edges, Vertices
item = ListItem(List=debrep.Faces, Index="4", Wrap=True)
area = Area(Geometry=item)  # -> Area, Centroid
srf_cp = SurfaceClosestPoint(Point=area.Centroid, Surface=item)  # -> Point, UVPoint, Distance
evalsrf = EvaluateSurface(Surface=item, Point=srf_cp.UVPoint)  # -> Point, Normal, UDirection, VDirection, Frame
pln_3 = Plane(flatten(evalsrf.Frame))

move = Move(Geometry=pln_2, Motion=Y)  # -> Geometry, Transform

pln_4 = Plane(pln_3)
deplane = DeconstructPlane(Plane=pln_4)  # -> Origin, XAxis, YAxis, ZAxis
devec = DeconstructVector(Vector=deplane.ZAxis)  # -> XComponent, YComponent, ZComponent
smaller = SmallerThan(FirstNumber=devec.ZComponent, SecondNumber="0")  # -> SmallerThan, OrEqualTo
sift = SiftPattern(List=pln_4, SiftPattern=smaller.SmallerThan)  # -> Output0, Output1
pflip = FlipPlane(Plane=sift.Output1, ReverseX=False, ReverseY=False, SwapAxes=True)
combine = CombineData(Input0=sift.Output0, Input1=pflip)  # -> Result, Index
data_5 = Data(combine.Result)

pl_3pt = Plane3Pt(PointA=pt_11, PointB=pt_13, PointC=pt_10)
rec_2pt = Rectangle2Pt(Plane=pl_3pt, PointA=pt_13, PointB=pt_10, Radius=0)  # -> Rectangle, Length
boundary = BoundarySurfaces(Edges=rec_2pt.Rectangle)
srf_cp_2 = SurfaceClosestPoint(Point=pt_12, Surface=boundary)  # -> Point, UVPoint, Distance
evalsrf_2 = EvaluateSurface(Surface=boundary, Point=srf_cp_2.UVPoint)  # -> Point, Normal, UDirection, VDirection, Frame
data_6 = Data(evalsrf_2.Frame)

data_7 = Data(pln)
data_8 = Data(move.Geometry)
filter = StreamFilter(Gate=list, Stream0=data_7, Stream1=data_8)
gripper_open_commands = Panel("""$OUT[2]=FALSE
$OUT[1]=TRUE""")
gripper_close_commands = Panel("""$OUT[1]=FALSE
$OUT[2]=TRUE""")
custom_krl = KUKAPrcCustomKRL(TextAsKRL=gripper_open_commands)
wait = KUKAPrcWait(KUKAPrcWait=gripper_open_waiting_time_sec)
custom_krl_2 = KUKAPrcCustomKRL(TextAsKRL=gripper_close_commands)
wait_2 = KUKAPrcWait(KUKAPrcWait=gripper_close_waiting_time_sec)
mesh_2 = Mesh(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)
kr_90_270_r2500 = KUKAQuantecKR90KR270R2500(infiniterot=False)
custom_tool = CustomToolForKUKAPrc(
    CustomToolGeometry=mesh_2,
    toolid=1,
    toolvala=0,
    toolvalb=-90,
    toolvalc=0,
    toolvalx=0,
    toolvaly=0,
    toolvalz=360,
    valuesset=True)

data_9 = Data(data_5)
group = Group(Objects=data_9)
data_10 = Data(group)

pt_14 = Point(data_9)

bbox = BoundingBox(Content=pt_14, Plane=PlaneXY(0, 0, 0), UnionBox=True)  # -> Box, Box_2
debrep_2 = DeconstructBrep(Brep=bbox.Box)  # -> Faces, Edges, Vertices
item_2 = ListItem(List=debrep_2.Faces, Index="4", Wrap=True)
area_2 = Area(Geometry=item_2)  # -> Area, Centroid
xy = XYPlane(Origin=area_2.Centroid)
orient = Orient(Geometry=data_10, Source=xy, Target=data_6)  # -> Geometry, Transform
ungroup = Ungroup(Group=orient.Geometry)

deplane_2 = DeconstructPlane(Plane=ungroup)  # -> Origin, XAxis, YAxis, ZAxis
partition = PartitionList(List=deplane_2.ZAxis, Size=Slider(6, range=0..10))
tstat = TreeStatistics(Tree=partition)  # -> Paths, Length, Count
lng = ListLength(List=tstat.Length)
dom = ConstructDomain(DomainStart=Slider(0, range=0..10), DomainEnd=Slider(34, range=1..34))
range = Range(Domain=dom, Steps=expr("X-1", lng))  # -> graft(Range)
addition = Addition(A="19", B=range)
amp = Amplitude(Vector=simplify(partition), Amplitude=simplify(addition))  # -> flatten(Vector)

move_2 = Move(Geometry=ungroup, Motion=amp)  # -> Geometry, Transform

# ---- group: 明天繼續
split = SplitList(List=move_2.Geometry, Index=Slider(6, range=0..300))  # -> ListA, ListB

# ----
panel_2 = Panel(range)

data_11 = Data(move_2.Geometry)

lng_2 = ListLength(List=data_11)

# ---- group: Preview
geo = Geometry(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)
bbox_2 = BoundingBox(Content=geo, Plane=PlaneXY(0, 0, 0))  # -> Box, Box_2
debrep_3 = DeconstructBrep(Brep=bbox_2.Box)  # -> Faces, Edges, Vertices
box = DomainBox(Base=PlaneXY(0, 0, 0), X=Slider(180, range=0..1000), Y=Slider(89, range=0..100), Z=Slider(38, range=0..100))
debrep_4 = DeconstructBrep(Brep=box)  # -> Faces, Edges, Vertices
item_3 = ListItem(List=debrep_3.Faces, Index=5, Wrap=True)
area_3 = Area(Geometry=item_3)  # -> Area, Centroid
item_4 = ListItem(List=debrep_4.Faces, Index=Slider(4, range=0..10), Wrap=True)
orient_2 = Orient(Geometry=geo, Source=area_3.Centroid, Target=pt_12)  # -> Geometry, Transform
area_4 = Area(Geometry=box)  # -> Area, Centroid
preview = CustomPreview(Geometry=orient_2.Geometry, Material=ColourSwatch(SwatchColor=RGBA(214, 214, 214, 114)))
xy_2 = XYPlane(Origin=area_4.Centroid)
xz = XZPlane(Origin=pt_12)
orient_3 = Orient(Geometry=box, Source=xy_2, Target=data_11)  # -> Geometry, Transform
prot = RotatePlane(Plane=xy_2, Angle=degrees("90"))
tag = TextTag3D(Location=xz, Text="Center", Size=80, Colour=RGB(0, 0, 0), Justification=5)
orient_4 = Orient(Geometry=box, Source=prot, Target=filter)  # -> Geometry, Transform
xz_2 = XZPlane(Origin=[pt_11, pt_13, pt_10])
panel_3 = Panel("""A
B
C""")
preview_2 = CustomPreview(Geometry=orient_4.Geometry, Material=ColourSwatch(SwatchColor=RGBA(255, 69, 69, 170)))
preview_3 = CustomPreview(Geometry=orient_3.Geometry, Material=ColourSwatch(SwatchColor=RGBA(156, 202, 255, 105)))
tag_2 = TextTag3D(Location=xz_2, Text=panel_3, Size=80, Colour=RGB(0, 0, 0), Justification=8)

# ----
repeat = RepeatData(Data=filter, Length=lng_2)
deplane_3 = DeconstructPlane(Plane=repeat)  # -> Origin, XAxis, YAxis, ZAxis
deplane_4 = DeconstructPlane(Plane=data_11)  # -> Origin, XAxis, YAxis, ZAxis
pl = ConstructPlane(Origin=pt_9, XAxis=deplane_3.XAxis, YAxis=deplane_3.YAxis)
amp_2 = Amplitude(Vector=deplane_3.ZAxis, Amplitude=picking_retraction_distance_mm)
repeat_2 = RepeatData(Data=pl, Length=lng_2)
amp_3 = Amplitude(Vector=deplane_4.ZAxis, Amplitude=placing_retraction_distance_mm)
prot_2 = RotatePlane(Plane=deplane_3.Origin, Angle=degrees("-90"))
move_3 = Move(Geometry=data_11, Motion=amp_3)  # -> Geometry, Transform
move_4 = Move(Geometry=prot_2, Motion=amp_2)  # -> Geometry, Transform
lng_3 = ListLength(List=orient_3.Geometry)
ptp_move = KUKAPrcPTPMovement(TargetAsPlane=repeat_2, extaxenabled=False, interpolation="C_PTP")
panel_4 = Panel(lng_3)
ptp_move_2 = PTPMovementKUKAPrc(TargetAsPlane=move_3.Geometry, extaxenabled=False, interpolation="C_PTP")
lin_move = KUKAPrcLINearMovement(TargetAsPlane=move_3.Geometry, extaxenabled=False, interpolation="C_DIS")
ptp_move_3 = PTPMovementKUKAPrc(TargetAsPlane=move_4.Geometry, extaxenabled=False, interpolation="C_PTP")
lin_move_2 = KUKAPrcLINearMovement(TargetAsPlane=data_11, extaxenabled=False, interpolation="C_DIS")
lin_move_3 = KUKAPrcLINearMovement(TargetAsPlane=prot_2, extaxenabled=False, interpolation="C_DIS")
lin_move_4 = KUKAPrcLINearMovement(TargetAsPlane=move_4.Geometry, extaxenabled=False, interpolation="C_DIS")
repeat_3 = RepeatData(Data=custom_krl_2, Length=lng_2)
repeat_4 = RepeatData(Data=wait_2, Length=lng_2)
repeat_5 = RepeatData(Data=ptp_move, Length=lng_2)
repeat_6 = RepeatData(Data=custom_krl, Length=lng_2)
repeat_7 = RepeatData(Data=wait, Length=lng_2)
cmd_weave = CommandWeaver(
    Command1=ptp_move_3,
    Command2=lin_move_3,
    Command3=repeat_3,
    Command4=repeat_4,
    Command5=lin_move_4,
    Command6=repeat_5,
    Command7=ptp_move_2,
    Command8=lin_move_2,
    Command9=repeat_6,
    Command10=repeat_7,
    Command11=lin_move,
    Command12=repeat_5,
    enabletree=False)
merge = Merge(Data1=wait, Data2=custom_krl, Data3=ptp_move, Data4=cmd_weave)  # -> flatten(Result)
gate = StreamGate(Stream=merge, Gate=list)  # -> Target0, Target1
kuka_prc = KUKAPrcCORE(
    SimulationSlider=number_slider,
    KUKAPrcCommands=gate.Target0,
    KUKAPrcTool=custom_tool,
    KUKAPrcRobot=kr_90_270_r2500,
    SaveToggle=save_krl_file,
    Filename=krl_file_name,
    PRC_BaseExpose=False,
    PRC_SaveNameExpose=True,
    PRCsettings="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")  # -> RobotGeometry, AnalysisOutput
kuka_prc_2 = KUKAPrcCORE(
    SimulationSlider=number_slider,
    KUKAPrcCommands=gate.Target1,
    KUKAPrcTool=custom_tool,
    KUKAPrcRobot=kr_90_270_r2500,
    SaveToggle=save_krl_file,
    Filename=krl_file_name,
    PRC_BaseExpose=False,
    PRC_SaveNameExpose=True,
    PRCsettings="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")  # -> RobotGeometry, AnalysisOutput
